# Dynamo graph step-surface.dyn (Dynamo 2.0.2.6826)

# group: Example Surface
code_block = CodeBlock()
# ---------- code_block.designscript (10 lines) ----------
num = 10;
x = 0..5..#num;
y = 0..6..#3;

// Z
z = Math.Sin(0..180..#num);
z1 = Math.MapTo(0, 1, z, 0, 1.4);
z2 = Math.MapTo(0, 1, z, 0, 2.5);
z3 = Math.MapTo(0, 1, z, 0, 0.6);
List.Transpose([z1, z2, z3]);
# ----------------------------------------
byCoordinates = Point.ByCoordinates(x=code_block.x, y=code_block.y@L2, z=code_block.out7, lacing=Longest)
byPoints = NurbsCurve.ByPoints(points=byCoordinates)
byLoft = Surface.ByLoft(crossSections=byPoints)

code_block_2 = CodeBlock(srf=byLoft)
# ---------- code_block_2.designscript (32 lines) ----------
u = 4;
v = 12;

//Divide Surface
uRange = (0..1..#u);
vRange = (0..1..#v);
pts = Surface.PointAtParameter(srf<1>, uRange<2>, vRange<3>);

//Make Steps
newPts = makeSteps(pts);

// Create polyCurves
polyCrvs = PolyCurve.ByPoints(
	Point.PruneDuplicates(newPts, 0.001),
	false
);

// New Surface
stepSrf = Surface.ByLoft(polyCrvs);

def makeSteps(pts: Point[]) {
	return [Imperative] {
		resultPts = [];
		count = List.Count(pts) - 1;
		for(i in 0..count) {
			old2Pt = pts[i+1 > count ? i : i + 1];
			new2Pt = Point.ByCoordinates(old2Pt.X, old2Pt.Y, pts[i].Z);
			resultPts = List.Join([resultPts, [pts[i], new2Pt]]);
		}
		return resultPts;
	};
};
# ----------------------------------------
