# Grasshopper definition step-surface.gh (Grasshopper 1.0.7)

# ---- group: preview surface
range = Range(Domain=Domain(0, 1), Steps=10)
graph = GraphMapper(
    range,
    x0=0,
    x1=1,
    y0=0,
    y1=1,
    container_name="Bezier",
    cpx=[0, 0.4328262806, 0.4838021398, 1],
    cpy=[0, 0, 0.5592501163, 0])
graph_2 = GraphMapper(range, x0=0, x1=1, y0=0, y1=1, container_name="Sine", Equation_px=[0, 0.5007246733], Equation_py=[0, 0.402535677])
graph_3 = GraphMapper(
    range,
    x0=0,
    x1=1,
    y0=0,
    y1=1,
    container_name="Bezier",
    cpx=[0, 0.4328262806, 0.215217486, 1],
    cpy=[0, 0, 0.3992751837, 0])
height = Slider(7, range=0..10)
length = Slider(10, range=0..10)
width = Slider(6, range=0..10)
entwine = Entwine(Branch00=graph, Branch01=graph_2, Branch02=graph_3, FlattenInputs=True)
range_2 = Range(Domain=length, Steps=2)  # -> graft(Range)
remap = RemapNumbers(Value=range, Source=Domain(0, 1), Target=width)  # -> Mapped, Clipped
remap_2 = RemapNumbers(Value=entwine, Source=Domain(0, 1), Target=height)  # -> Mapped, Clipped
Y = UnitY(Factor=range_2)
pt = ConstructPoint(XCoordinate=remap.Mapped, YCoordinate=0, ZCoordinate=remap_2.Mapped)
move = Move(Geometry=pt, Motion=Y)  # -> Geometry, Transform
intcrv = Interpolate(Vertices=move.Geometry, Degree=3, Periodic=False, KnotStyle=1)  # -> Curve, Length, Domain
loft = Loft(
    Curves=flatten(intcrv.Curve),
    Options={Adjust=False, Closed=False, LoftEnds=0, LoftSimp=0, LoftType=0, Rebuild=10, Refit=0.01})

# ----
srf = Surface(loft)
sdivide = DivideSurface(Surface=srf, UCount=Slider(2, range=0..10), VCount=Slider(10, range=0..10))  # -> Points, Normals, Parameters
pdecon = Deconstruct(Point=sdivide.Points)  # -> XComponent, YComponent, ZComponent
false = Boolean(False)
pt_2 = ConstructPoint(XCoordinate=pdecon.XComponent, YCoordinate=pdecon.YComponent, ZCoordinate=0)
dup = DuplicateData(Data=pdecon.ZComponent, Number=2, Order=false)
shift = ShiftList(List=pt_2, Shift=1, Wrap=False)
Z = UnitZ(Factor=dup)
shift_2 = ShiftList(List=pt_2, Shift=-1, Wrap=False)
weave = Weave(Pattern=[0, 1], Stream0=shift_2, Stream1=shift, NullGaps=False)
shift_3 = ShiftList(List=Z, Shift=-1, Wrap=False)
move_2 = Move(Geometry=weave, Motion=shift_3)  # -> Geometry, Transform
pt_3 = Point(move_2.Geometry)
pline = PolyLine(Vertices=pt_3, Closed=False)
loft_2 = Loft(Curves=flatten(pline), Options={Adjust=False, Closed=False, LoftEnds=0, LoftSimp=0, LoftType=0, Rebuild=10, Refit=0.01})
